# Grasshopper definition TopologyBrepEdge.gh (Grasshopper 1.0.7)
# plug-ins: Sandbox Topology

edge = Slider(18, range=0..47)
# © 2013 by Tobias Schwinn
brep = Brep(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)
debrep = DeconstructBrep(Brep=brep)  # -> Faces, Edges, Vertices
brep_topo = BrepTopology(Brep=brep)  # -> FaceEdgeStructure, EdgeFaceStructure
pcen = PolygonCenter(Polyline=debrep.Faces)  # -> CenterV, CenterE, CenterA
eval = EvaluateLength(Curve=debrep.Edges, Length=0.5, Normalized=True)  # -> Point, Tangent, Parameter
branch = TreeBranch(Tree=brep_topo.EdgeFaceStructure, Path=edge, MaintainPaths=True)
ef = Panel(branch)
item = ListItem(List=debrep.Edges, Index=edge, Wrap=True)
item_2 = ListItem(List=debrep.Faces, Index=branch, Wrap=True)
points = PointList(Points=pcen.CenterV, Tags=True, Lines=False, Size=20)
points_2 = PointList(Points=eval.Point, Tags=True, Lines=False, Size=15)
pipe = Pipe(Curve=item, Radius=5, Caps=0)
