# Grasshopper definition TopologyBrepVertex.gh (Grasshopper 1.0.7)
# plug-ins: Sandbox Topology

vertex = Slider(5, range=0..47)
# © 2013 by Tobias Schwinn
brep = Brep(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)
debrep = DeconstructBrep(Brep=brep)  # -> Faces, Edges, Vertices
brep_topo_vertex = BrepTopologyVertex(Brep=brep)  # -> FaceVertexStructure, VertexFaceStructure
pcen = PolygonCenter(Polyline=debrep.Faces)  # -> CenterV, CenterE, CenterA
eval = EvaluateLength(Curve=debrep.Edges, Length=0.5, Normalized=True)  # -> Point, Tangent, Parameter
branch = TreeBranch(Tree=brep_topo_vertex.VertexFaceStructure, Path=vertex, MaintainPaths=True)
vf = Panel(branch)
item = ListItem(List=debrep.Vertices, Index=vertex, Wrap=True)
item_2 = ListItem(List=debrep.Faces, Index=branch, Wrap=True)
points = PointList(Points=debrep.Vertices, Tags=True, Lines=False, Size=15)
points_2 = PointList(Points=pcen.CenterV, Tags=True, Lines=False, Size=20)
sph = Sphere(Base=item, Radius=15)
