# Grasshopper definition TopologyLine.gh (Grasshopper 1.0.7)
# plug-ins: Sandbox Topology

# © 2025 by Tobias Schwinn
line = Line([Line((196.4149286, -236.0513623, 0), (249.2949603, 44.10912772, 0)), Line((249.2949603, 44.10912772, 0), (142.3157124, 128.6884568, 0)), Line((142.3157124, 128.6884568, 0), (110.557747, 112.1528378, 0)), Line((110.557747, 112.1528378, 0), (78.19701287, 46.10594781, 0)), Line((78.19701287, 46.10594781, 0), (142.5102593, -228.4365666, 0)), Line((613.7365464, 529.0708899, 0), (567.0201741, 276.041333, 0))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])
point = Slider(26, range=0..47)
eval = EvaluateLength(Curve=line, Length=0.5, Normalized=True)  # -> Point, Tangent, Parameter
linetopoidx = LineTopologyIndex(ListOfLines=line, Tolerance=0.001)  # -> ListOfPoints, LinePointStructure, PointPointStructure, PointLineStructure
branch = TreeBranch(Tree=simplify(linetopoidx.PointPointStructure), Path=point, MaintainPaths=True)
branch_2 = TreeBranch(Tree=simplify(linetopoidx.PointLineStructure), Path=point, MaintainPaths=True)
points = PointList(Points=eval.Point, Tags=True, Lines=False, Size=7)
points_2 = PointList(Points=linetopoidx.ListOfPoints, Tags=True, Lines=False, Size=10)
pp = Panel(branch)
item = ListItem(List=line, Index=branch_2, Wrap=True)
item_2 = ListItem(List=linetopoidx.ListOfPoints, Index=branch, Wrap=True)
pl = Panel(branch_2)

pipe = Pipe(Curve=item, Radius=2, Caps=0)
sph = Sphere(Base=item_2, Radius=10)
