# Grasshopper definition TopologyMeshVertexFilter.gh (Grasshopper 0.9.56)
# plug-ins: MeshEdit Components, Sandbox, Weaverbird

mesh = Mesh(<mesh referenced from the Rhino model>)
valency = Slider(5, range=1..7)

mesh_topo_vertex = MeshTopologyVertex(Mesh=mesh)  # -> ListOfMeshVertices, VertexVertexStructure, VertexFaceStructure
mesh_topo_vertex_filter = MeshTopologyVertexFilter(
    VertexList=mesh_topo_vertex.ListOfMeshVertices,
    VertexFaceStructure=mesh_topo_vertex.VertexFaceStructure,
    ValencyFilter=valency)  # -> ListOfVertexIDs, ListOfVertices

wbfacepolys = WeaverbirdsFacePolylines(Mesh=mesh)
explode = MeshExplode(Mesh=mesh, Interpolate=False)
pcen = PolygonCenter(Polyline=wbfacepolys)  # -> CenterV, CenterE
branch = TreeBranch(Tree=mesh_topo_vertex.VertexFaceStructure, Path=mesh_topo_vertex_filter.ListOfVertexIDs, MaintainPaths=True)
V = Panel(mesh_topo_vertex_filter.ListOfVertexIDs)
points = PointList(Points=pcen.CenterV, Tags=True, Lines=False, Size=20)
points_2 = PointList(Points=mesh_topo_vertex.ListOfMeshVertices, Tags=True, Lines=False, Size=15)
item = ListItem(List=explode, Index=branch, Wrap=True)
sph = Sphere(Base=mesh_topo_vertex_filter.ListOfVertices, Radius=15)
