# Grasshopper definition TopologyPolyPoint.gh (Grasshopper 1.0.7)
# plug-ins: LunchBox, Sandbox Topology

# © 2013 by Tobias Schwinn
tolerance = Slider(0.001, range=0.001..1)
point = Slider(6, range=0..47)
crv = Curve([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])
pcen = PolygonCenter(Polyline=crv)  # -> CenterV, CenterE, CenterA
topology = PolygonTopology(ListOfPolylines=crv, Tolerance=tolerance)  # -> ListOfPoints, LoopPointStructure, PointLoopStructure
branch = TreeBranch(Tree=simplify(topology.PointLoopStructure), Path=point, MaintainPaths=True)
points = PointList(Points=pcen.CenterV, Tags=True, Lines=False, Size=20)
points_2 = PointList(Points=topology.ListOfPoints, Tags=True, Lines=False, Size=15)
pl = Panel(branch)
item = ListItem(List=crv, Index=branch, Wrap=True)
item_2 = ListItem(List=topology.ListOfPoints, Index=point, Wrap=True)
sph = Sphere(Base=item_2, Radius=20)
patch = PatchSurface(EdgeCurves=graft(item), U=2, V=2, Tolerance=0.001)
